# Grasshopper definition 1023.gh (Grasshopper 1.0.7)
# plug-ins: RhinoCodePluginGH

path = FilePath("C:\Users\zy2678\Desktop\DI DATA\111.geojson")
path_2 = FilePath("C:\Users\zheng\OneDrive - Louisiana State University\Documents\1 GSAPP\2 Design Intelligence\Automated Retail Store Layout\processed\open_space.geojson")
py3 = Python3Script(x=path)  # -> out, a; disabled
# ---------- py3: Python ----------
import json
import Rhino.Geometry as rg

# Input from File Path (from Grasshopper File Path component)
geojson_file_path = x

# Open and load GeoJSON file with UTF-8 encoding
with open(geojson_file_path, 'r', encoding='utf-8') as f:
    data = json.load(f)

# Function to extract geometry from GeoJSON feature
def parse_geojson_geometry(geo):
    geo_type = geo["type"]
    coords = geo["coordinates"]

    if geo_type == "Point":
        x, y = coords
        point = rg.Point3d(x, y, 0)  # No scaling, already in feet
        return point

    elif geo_type == "LineString":
        points = [rg.Point3d(x, y, 0) for x, y in coords]
        polyline = rg.Polyline(points)
        return polyline.ToNurbsCurve()

    elif geo_type == "Polygon":
        outer_ring = coords[0]
        points = [rg.Point3d(x, y, 0) for x, y in outer_ring]
        polygon = rg.Polyline(points)
        return polygon.ToNurbsCurve()

    else:
        return None

# Extract geometries from GeoJSON
geometries = []
for feature in data["features"]:
    geo = feature["geometry"]
    geom = parse_geojson_geometry(geo)
    if geom:
        geometries.append(geom)

# Output geometries to Grasshopper
a = geometries
# ---------- end py3 ----------
py3_2 = Python3Script(x=path_2)  # -> out, a
# ---------- py3_2: Python ----------
import json
import math
import Rhino.Geometry as rg

# Constants for approximate conversion (for small areas)
feet_per_degree_lat = 364000  # Approximate feet per degree of latitude
feet_per_degree_lon = 288200  # Approximate feet per degree of longitude at the equator

# Central reference point (close to your area of interest, such as New York City)
central_latitude = 40.7128   # Example: New York City's latitude
central_longitude = -74.0060  # Example: New York City's longitude

# Input from File Path (from Grasshopper File Path component)
geojson_file_path = x

# Open and load GeoJSON file with UTF-8 encoding
with open(geojson_file_path, 'r', encoding='utf-8') as f:
    data = json.load(f)

# Function to convert lat/lon to feet coordinates based on the scaled approximation
def latlon_to_feet(lat, lon):
    # Scale longitude by the cosine of the latitude
    x_feet = (lon - central_longitude) * (math.cos(math.radians(lat)) * feet_per_degree_lon)
    y_feet = (lat - central_latitude) * feet_per_degree_lat
    return x_feet, y_feet

# Function to extract and convert geometry from GeoJSON feature
def parse_geojson_geometry(geo):
    geo_type = geo["type"]
    coords = geo["coordinates"]

    if geo_type == "Point":
        lon, lat = coords
        x_feet, y_feet = latlon_to_feet(lat, lon)
        point = rg.Point3d(x_feet, y_feet, 0)  # Now in feet
        return point

    elif geo_type == "LineString":
        points = []
        for lon, lat in coords:
            x_feet, y_feet = latlon_to_feet(lat, lon)
            points.append(rg.Point3d(x_feet, y_feet, 0))
        polyline = rg.Polyline(points)
        return polyline.ToNurbsCurve()

    elif geo_type == "Polygon":
        outer_ring = coords[0]
        points = []
        for lon, lat in outer_ring:
            x_feet, y_feet = latlon_to_feet(lat, lon)
            points.append(rg.Point3d(x_feet, y_feet, 0))
        polygon = rg.Polyline(points)
        return polygon.ToNurbsCurve()

    else:
        return None

# Extract geometries from GeoJSON
geometries = []
for feature in data["features"]:
    geo = feature["geometry"]
    geom = parse_geojson_geometry(geo)
    if geom:
        geometries.append(geom)

# Output geometries to Grasshopper
a = geometries
# ---------- end py3_2 ----------
ghpython_script = GhPythonScript()  # -> out, a
# ---------- ghpython_script: Python ----------
import json
import math
import Rhino.Geometry as rg

# Constants for approximate conversion (for small areas)
feet_per_degree_lat = 364000  # Approximate feet per degree of latitude
feet_per_degree_lon = 288200  # Approximate feet per degree of longitude at the equator

# Central reference point (close to your area of interest, such as New York City)
central_latitude = 40.7128   # Example: New York City's latitude
central_longitude = -74.0060  # Example: New York City's longitude

# Input from File Path (from Grasshopper File Path component)
geojson_file_path = x

# Open and load GeoJSON file with UTF-8 encoding
with open(geojson_file_path, 'r', encoding='utf-8') as f:
    data = json.load(f)

# Function to convert lat/lon to feet coordinates based on the scaled approximation
def latlon_to_feet(lat, lon):
    # Scale longitude by the cosine of the latitude
    x_feet = (lon - central_longitude) * (math.cos(math.radians(lat)) * feet_per_degree_lon)
    y_feet = (lat - central_latitude) * feet_per_degree_lat
    return x_feet, y_feet

# Function to extract and convert geometry from GeoJSON feature
def parse_geojson_geometry(geo):
    geo_type = geo["type"]
    coords = geo["coordinates"]

    if geo_type == "Point":
        lon, lat = coords
        x_feet, y_feet = latlon_to_feet(lat, lon)
        point = rg.Point3d(x_feet, y_feet, 0)  # Now in feet
        return point

    elif geo_type == "LineString":
        points = []
        for lon, lat in coords:
            x_feet, y_feet = latlon_to_feet(lat, lon)
            points.append(rg.Point3d(x_feet, y_feet, 0))
        polyline = rg.Polyline(points)
        return polyline.ToNurbsCurve()

    elif geo_type == "Polygon":
        outer_ring = coords[0]
        points = []
        for lon, lat in outer_ring:
            x_feet, y_feet = latlon_to_feet(lat, lon)
            points.append(rg.Point3d(x_feet, y_feet, 0))
        polygon = rg.Polyline(points)
        return polygon.ToNurbsCurve()

    else:
        return None

# Extract geometries from GeoJSON
geomet
# ---------- end ghpython_script ----------
py3_3 = Python3Script(lat=Slider(40.7532, range=0..100), lon=Slider(-73.9822, range=-80..-60))  # -> out, a
# ---------- py3_3: Python ----------
import math
import Rhino.Geometry as rg

# Constants for approximate conversion (for small areas)
feet_per_degree_lat = 364000  # Approximate feet per degree of latitude
feet_per_degree_lon = 288200  # Approximate feet per degree of longitude at the equator

# Central reference point (this should be close to your target region)
central_latitude = 40.7128   # Example: New York City's latitude
central_longitude = -74.0060  # Example: New York City's longitude

# Input latitude and longitude (from user)
latitude = lat
longitude = lon

# Conversion formulas
x_feet = (longitude - central_longitude) * (math.cos(math.radians(latitude)) * feet_per_degree_lon)
y_feet = (latitude - central_latitude) * feet_per_degree_lat

# Create the Rhino point
point = rg.Point3d(x_feet, y_feet, 0)

# Output the point
a = point
# ---------- end py3_3 ----------
pt = ConstructPoint(XCoordinate=Slider(254, range=0..1000), YCoordinate=Slider(200, range=0..1000), ZCoordinate=0)  # disabled
pt_2 = Point()
panel = Panel(pt_2)
circle = CircleCNR(Center=pt, Normal=Vector(0, 0, 1), Radius=Slider(250, range=0..1000))
store_location_pt = Point()
mapping_pt = Point()
circle_2 = CircleCNR(Center=store_location_pt, Normal=Vector(0, 0, 1), Radius=Slider(250, range=0..1000))
hidden_circle = CircleCNR(Center=store_location_pt, Normal=Vector(0, 0, 1), Radius=Slider(1000, range=0..1000))
incurve = PointInCurve(Point=mapping_pt, Curve=circle_2)  # -> Relationship, Point
incurve_2 = PointInCurve(Point=mapping_pt, Curve=hidden_circle)  # -> Relationship, Point
cull = CullPattern(List=mapping_pt, CullPattern=incurve_2.Relationship)
cull_2 = CullPattern(List=mapping_pt, CullPattern=incurve.Relationship)
lng = ListLength(List=cull_2)
lng_2 = ListLength(List=cull)
panel_2 = Panel(lng_2)
panel_3 = Panel(lng)
